# Grasshopper definition basic-attractor-polygon.gh (Grasshopper 1.0.7)

srf = Surface(<surface referenced from the Rhino model>)
# Basic Attractor - Polygon (27 Oct 2019)
# by RJ Duran (rj.duran@colorado.edu)
# Critical Making Studio, Fall 2019
# http://make.cmci.studio
# Input: Subdivided Surface
# (Grid of Points)
number_slider = Slider(0.57, range=0.125..1)
# Association Point
# aka Attractor
sdivide = DivideSurface(Surface=reparameterize(srf), UCount=Slider(10, range=1..10), VCount=Slider(10, range=1..10))  # -> Points, Normals, Parameters
points = PointList(Points=sdivide.Points, Size=number_slider)
pt = Point(sdivide.Points)
pt_2 = Point(<point referenced from the Rhino model>)
dist = Distance(PointA=pt, PointB=pt_2)
bnd = Bounds(Numbers=flatten(dist))
dom = ConstructDomain(DomainStart=Slider(0.063, range=0.063..1), DomainEnd=Slider(0.5, range=0..1))
remap = RemapNumbers(Value=dist, Source=bnd, Target=dom)  # -> Mapped, Clipped
# Output: Polygons located at each point
# with variable radius
polygon = Polygon(Plane=pt, Radius=remap.Mapped, Segments=Slider(6, range=3..9), FilletRadius=0)  # -> Polygon, Length
flatten = FlattenTree(Tree=polygon.Polygon, Path="{0}")
srf_2 = Surface(polygon.Polygon)

# ---- group: Bake Me!
# Grouped curves
group = Group(Objects=flatten)

# ----
preview = CustomPreview(Geometry=srf_2, Material=ColourSwatch(SwatchColor=RGB(0, 0, 0)))
